# Grasshopper definition 3rob_cell_visualize.ghx (Grasshopper 1.0.7)

# ----
# ROBOT CONNECT
panel = Panel("ros-79hh-s4fg.yaler.io")
ros = ROSConnect(connect=Toggle(True))  # -> ros_client, is_connected; inputs port: Int32, connect: Boolean
#   port ip: The ip address ROS. Defaults to 127.0.0.1.
#   port port: The port of ROS. Defaults to 9090.
#   port connect: If True, connects to ROS. If False, disconnects from ROS. Defaults to False.
#   port ros_client: The ROS client.
#   port is_connected: True if connection established.
# ---------- ros: Python ----------
"""
Connect or disconnect to ROS.

COMPAS FAB v0.19.1
"""
from ghpythonlib.componentbase import executingcomponent as component
from scriptcontext import sticky as st

from compas_fab.backends import RosClient
from compas_fab.ghpython.components import create_id


class ROSConnect(component):
    def RunScript(self, ip, port, connect):
        ros_client = None

        ip = ip or '127.0.0.1'
        port = port or 9090

        key = create_id(self, 'ros_client')
        ros_client = st.get(key, None)

        if ros_client:
            st[key].close()
        if connect:
            st[key] = RosClient(ip, port)
            st[key].run(5)

        ros_client = st.get(key, None)
        is_connected = ros_client.is_connected if ros_client else False
        return (ros_client, is_connected)
# ---------- end ros ----------
data = Data(ros.ros_client)
robot = ROSRobot(ros_client=data, load=Toggle(True))  # -> robot; inputs load: Boolean
#   port ros_client: The ROS client.
#   port load: If True, loads the robot from ROS. Defaults to False.
# ---------- robot: Python ----------
"""
Load robot directly from ROS.

COMPAS FAB v0.19.1
"""
from compas_ghpython.artists import RobotModelArtist
from ghpythonlib.componentbase import executingcomponent as component
from scriptcontext import sticky as st

from compas_fab.ghpython.components import create_id


class ROSRobot(component):
    def RunScript(self, ros_client, load):
        key = create_id(self, 'robot')

        if ros_client and ros_client.is_connected and load:
            # Load URDF from ROS
            st[key] = ros_client.load_robot(load_geometry=True, precision='12f')
            st[key].artist = RobotModelArtist(st[key].model)

        robot = st.get(key, None)
        if robot:  # client sometimes need to be restarted, without needing to reload geometry
            robot.client = ros_client
        return robot
# ---------- end robot ----------
data_2 = Data(robot)

# ----
# ECL PLATFORM MESH
mesh = Mesh([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])

list = ValueList({"tool_gripper": "ecl_pneumatic_gripper", "tool_calibration": "ecl_rob2_calibration_tip"}, selected="tool_calibration")
list_2 = ValueList({"tool_gripper": "ecl_pneumatic_gripper", "tool_calibration": "ecl_rob1_calibration_tip"}, selected="tool_calibration")
list_3 = ValueList({"tool_gripper": "ecl_pneumatic_gripper", "tool_calibration": "ecl_rob3_calibration_tip"}, selected="tool_calibration")

# ----
# READ IN 3 POINT WOBJ CONFIGS
panel_2 = Panel("/Users/edvard/Documents/github/zerowaste_robot/configs/presets")
# make sure you compose-up and are using the URDF with the correct tool and TCF location defined. Before defined tool frame manually (but this obsolete now)
list_4 = ValueList({"x1", "x2", "y1"}, selected="x1")
python = GhPythonScript(robot=data_2, path=panel_2, point=list_4, read_data=Toggle(True))  # -> config, config_scaled
# ---------- python: Python ----------
import os
import math
from compas_fab.utilities import read_data_from_json
from compas_fab.robots import Configuration


config = robot.zero_configuration()

if read_data:
    
    for rob_num in range(1,4):
        data = read_data_from_json(os.path.join(path, 'R{}/wobj_{}.json'.format(rob_num,point)))
        #data = read_data_from_json(os.path.join(path, 'R{}\wobj_{}.json'.format(rob_num,point)))
        
        c = Configuration.from_data(data)
        
        if rob_num in [1, 2]:  # only R1 and R2 have an external axis
            config["r{}_cart_joint".format(rob_num)] = c.get("r{}_cart_joint".format(rob_num))
    
        config["r{}_joint_1".format(rob_num)] = c.get("r{}_joint_1".format(rob_num))
        config["r{}_joint_2".format(rob_num)] = c.get("r{}_joint_2".format(rob_num))
        config["r{}_joint_3".format(rob_num)] = c.get("r{}_joint_3".format(rob_num))
        config["r{}_joint_4".format(rob_num)] = c.get("r{}_joint_4".format(rob_num))
        config["r{}_joint_5".format(rob_num)] = c.get("r{}_joint_5".format(rob_num))
        config["r{}_joint_6".format(rob_num)] = c.get("r{}_joint_6".format(rob_num))

print(config)

config_scaled = robot.zero_configuration()

for i in range(6):
    config_scaled['r1_joint_{}'.format(i + 1)] = math.radians(config['r1_joint_{}'.format(i + 1)])
    config_scaled['r2_joint_{}'.format(i + 1)] = math.radians(config['r2_joint_{}'.format(i + 1)])
    config_scaled['r3_joint_{}'.format(i + 1)] = math.radians(config['r3_joint_{}'.format(i + 1)])

#mm --> m
config_scaled['r1_cart_joint'] = config['r1_cart_joint'.format(i + 1)]/1000
config_scaled['r2_cart_joint'] = config['r2_cart_joint'.format(i + 1)]/1000

print(config_scaled)
# ---------- end python ----------

# ----
# Robot 1
j1 = Slider(8.53, range=-180..180)
j2 = Slider(2.36, range=-90..150)
j3 = Slider(-22.38, range=-180..75)
j4 = Slider(247.06, range=-400..400)
j5 = Slider(98.93, range=-125..120)
j6 = Slider(138.61, range=-400..400)
track = Slider(0.10011, range=0..4)
data_3 = Data([j1, j2, j3, j4, j5, j6, track])

# ----
# Robot 2
j1_2 = Slider(27.95, range=-180..180)
j2_2 = Slider(0.01, range=-90..150)
j3_2 = Slider(20.37, range=-180..75)
j4_2 = Slider(208.55, range=-400..400)
j5_2 = Slider(54.9, range=-125..120)
j6_2 = Slider(-124.69, range=-400..400)
track_2 = Slider(3.8999, range=0..4)
data_4 = Data([j1_2, j2_2, j3_2, j4_2, j5_2, j6_2, track_2])

# ----
# Robot 3
j1_3 = Slider(1.16, range=-180..180)
j2_3 = Slider(-7.09, range=-90..150)
j3_3 = Slider(-2.8, range=-180..75)
j4_3 = Slider(-284.75, range=-400..400)
j5_3 = Slider(22.84, range=-125..120)
j6_3 = Slider(-20.34, range=-400..400)
data_5 = Data([j1_3, j2_3, j3_3, j4_3, j5_3, j6_3])

# ----
# Planning Preset
python_2 = GhPythonScript()  # -> config
# ---------- python_2: Python ----------
#axis 1-6
config = [
40.55,
16.21,
-13.89,
-0.0,
87.68,
130.55]
# ---------- end python_2 ----------
# PRESET CONFIGS
python_3 = GhPythonScript()  # -> config
# ---------- python_3: Python ----------
#ROBOT 1 CONFIG
#Start path planning from

#axis 1-6 + track (mm)
config = [
-37.57,
-3.24,
8.36,
0.19,
84.45,
230,
100]

#config = [
#-37.57,
#-3.24,
#8.36,
#0.19,
#84.45,
#230,
#100]
# ---------- end python_3 ----------
python_4 = GhPythonScript()  # -> config
# ---------- python_4: Python ----------
#ROBOT 1 CONFIG
#Start path planning from

#axis 1-6 + track
config = [
40.55,
16.21,
-13.89,
-0.0,
87.68,
130.55,
3900]

#axis 1-6 + track
#config = [40.55,16.21,-13.89,-0.0,87.68,130.55,3900]
# ---------- end python_4 ----------
config = GhPythonScript(robot=data_2, r1=python_3, r2=python_4, r3=python_2)  # -> config, config_scaled; inputs r1: list, r2: list, r3: list
# ---------- config: Python ----------
import math

config = robot.zero_configuration()

for i in range(6):
    config['r1_joint_{}'.format(i + 1)] = r1[i]
    config['r2_joint_{}'.format(i + 1)] = r2[i]
    config['r3_joint_{}'.format(i + 1)] = r3[i]

#mm
config['r1_cart_joint'] = r1[6]
config['r2_cart_joint'] = r2[6]

print config

#for use in path planning
#radians and meters
config_scaled = robot.zero_configuration()

for i in range(6):
    config_scaled['r1_joint_{}'.format(i + 1)] = math.radians(r1[i])
    config_scaled['r2_joint_{}'.format(i + 1)] = math.radians(r2[i])
    config_scaled['r3_joint_{}'.format(i + 1)] = math.radians(r3[i])

#mm --> m
config_scaled['r1_cart_joint'] = r1[6]/1000
config_scaled['r2_cart_joint'] = r2[6]/1000

print config_scaled
# ---------- end config ----------

# ----
# Return Preset
python_5 = GhPythonScript()  # -> config
# ---------- python_5: Python ----------
#RETURN CONFIG (BEFORE PICKUP)

#axis 1-6 + track (mm)
config = [
-90.0,
0.0,
0.0,
0.0,
90,
180,
100]
# ---------- end python_5 ----------
python_6 = GhPythonScript()  # -> config
# ---------- python_6: Python ----------
#RETURN CONFIG (BEFORE PICKUP)

#axis 1-6 + track
config = [
90.0,
0.0,
0.0,
0.0,
90,
180,
3900]
# ---------- end python_6 ----------
python_7 = GhPythonScript()  # -> config
# ---------- python_7: Python ----------
#axis 1-6
config = [
90.0,
0.0,
0.0,
0.0,
90,
180]
# ---------- end python_7 ----------
config_2 = GhPythonScript(robot=data_2, r1=python_5, r2=python_6, r3=python_7)  # -> config, config_scaled; inputs r1: list, r2: list, r3: list; same code as config

list_5 = ValueList({"Robot 1": 1, "Robot 2": 2, "Robot 3": 3}, selected="Robot 2")

python_8 = GhPythonScript()  # -> wobj2_mm, wobj2_m, draw_wobj2_m
# ---------- python_8: Python ----------
from compas.geometry import Frame
from compas_ghpython.artists import FrameArtist

#THIS IS WOBJ FOR R2
p = [3107.65,1478.91,367.994]
wobj2_mm = Frame.from_quaternion([0.99999,-0.00305874,-0.00165978,-0.0029736], p)

p = [3.10765,1.47891,0.367994]
wobj2_m = Frame.from_quaternion([0.99999,-0.00305874,-0.00165978,-0.0029736], p)

artist = FrameArtist(wobj2_m)
draw_wobj2_m = artist.draw()
# ---------- end python_8 ----------
python_9 = GhPythonScript()  # -> wobj1_mm, draw_wobj1_m
# ---------- python_9: Python ----------
from compas.geometry import Frame
from compas_ghpython.artists import FrameArtist

#THIS IS WOBJ FOR R1
p=[3103.33,1481.11,366.83]
wobj1_mm = Frame.from_quaternion([0.999976,-0.00604606,-0.00149283,-0.0029774],p)

p=[3.10333,1.48111,0.36683]
wobj1_m = Frame.from_quaternion([0.999976,-0.00604606,-0.00149283,-0.0029774],p)

artist = FrameArtist(wobj1_m)
draw_wobj1_m = artist.draw()
# ---------- end python_9 ----------
python_10 = GhPythonScript()  # -> wobj3_m, draw_wobj3_m
# ---------- python_10: Python ----------
from compas.geometry import Frame
from compas_ghpython.artists import FrameArtist

#THIS IS WOBJ FOR R3
p = [1776.27,240.085,695.195]
wobj3_mm = Frame.from_quaternion([0.00447221,-0.000156608,-0.00949994,0.999945], p)

p = [1.77627,0.240085,0.695195]
wobj3_m = Frame.from_quaternion([0.00447221,-0.000156608,-0.00949994,0.999945], p)

artist = FrameArtist(wobj3_m)
draw_wobj3_m = artist.draw()
# ---------- end python_10 ----------
pln = Plane(python_8.draw_wobj2_m)
pln_2 = Plane(python_9.draw_wobj1_m)
pln_3 = Plane(python_10.draw_wobj3_m)

python_11 = GhPythonScript(wobj2_m=python_8.wobj2_m)  # -> test_point, draw_testpoint
# ---------- python_11: Python ----------
from compas.geometry import Frame
from compas.geometry import Point
from compas.geometry import Vector

from compas_ghpython.artists import FrameArtist
from compas_ghpython.artists import PointArtist
from compas.geometry import Translation

p = wobj2_m.point

##################
t = Translation.from_vector(wobj2_m.xaxis)
test_point = Point.from_data(p).transformed(t)
print test_point
##################


artist = PointArtist(test_point)
draw_testpoint = artist.draw()
# ---------- end python_11 ----------
pt = Point(python_11.draw_testpoint)

# ----
# make the work object for R3 be its base. This is basically the process for finding where the base of R3 lives in space.
# 
# wobj3_base_mm, is the transformation that is required to get a point in space into R3s coordinate frame
python_12 = GhPythonScript(wobj3=python_10.wobj3_m, wobj2=python_8.wobj2_m, p2=python_11.test_point)  # -> out, wobj3_base_mm, wobj3_new_out, p2_new_out
# ---------- python_12: Python ----------
from compas.geometry import Transformation
from compas_ghpython.artists import FrameArtist
from compas_ghpython.artists import PointArtist

from compas.geometry import Frame
from compas.geometry import Point
from compas.geometry import Vector
from compas.geometry import Transformation
from compas.geometry import Translation
from compas.geometry import translate_points

import copy

################
#ASSUMING R2 IS GROUND TRUTH, TRANSFORM REST TO MATCH

print "wobj to transform: ", wobj3

# location of wobj to transform (ROBOT 3)
x,y,z = wobj3.point
print "\n", x, y, z

#Scaling vectors (in dirn of wobj to transform)
vec_x = -wobj3.xaxis.unitized().scaled(x)
vec_y = -wobj3.yaxis.unitized().scaled(y)
vec_z = -wobj3.zaxis.unitized().scaled(z)
print "\n", vec_x, vec_y, vec_z

#New wobj transformed from the location of the correct wobj
p_wobj_new = copy.deepcopy(wobj2.point)

p_wobj_new.transform(Translation.from_vector(vec_x))
p_wobj_new.transform(Translation.from_vector(vec_y))
p_wobj_new.transform(Translation.from_vector(vec_z))
print "\n", p_wobj_new

wobj3_new = copy.deepcopy(wobj3)
wobj3_new.point = p_wobj_new
print "\n NEW WOBJ: ", wobj3_new

p2_in_wobj3_new = wobj3_new.to_local_coordinates(p2)
print "\nPoint in World to Send; ", p2_in_wobj3_new 

###################
wobj3_base_mm = copy.deepcopy(wobj3_new)
wobj3_base_mm.point  = wobj3_base_mm.point*1000
print wobj3_base_mm
###################


############
artist = FrameArtist(wobj3_new)
wobj3_new_out = artist.draw()

artist = PointArtist(p2_in_wobj3_new)
p2_new_out = artist.draw()
################
# ---------- end python_12 ----------
data_6 = Data(python_9.wobj1_mm)
data_7 = Data(python_8.wobj2_mm)
data_8 = Data(python_12.wobj3_base_mm)
pln_4 = Plane(python_12.wobj3_new_out)
pt_2 = Point(python_12.p2_new_out)

data_9 = Data(config_2.config)

# ----
# If axis is included then allow the robot to move along track
rob_num = Number(list_5)
list_6 = ValueList({"Robot 1 - No Track, No Gripper": "robot1_notrack", "Robot 1 - No Track, Gripper": "robot1_notrack_gripper", "Robot 1 - Track, No Gripper": "robot1_track", "Robot 1 - Track, Gripper": "robot1_track_gripper"}, selected="Robot 1 - Track, Gripper")
list_7 = ValueList({"Robot 2 - No Track, No Gripper": "robot2_notrack", "Robot 2 - No Track, Gripper": "robot2_notrack_gripper", "Robot 2 - Track, No Gripper": "robot2_track", "Robot 2 - Track, Gripper": "robot2_track_gripper"}, selected="Robot 2 - No Track, Gripper")
list_8 = ValueList({"Robot 3 - No Gripper": "robot3", "Robot 3 - Gripper": "robot3_gripper"}, selected="Robot 3 - Gripper")
list_9 = ValueList({"platform": "ecl_platform", "wobj0", "acadia": "rob1_acadia_EBIT_01", "zerowaste": "ecl_rob1_zerowaste"}, selected="zerowaste")
list_10 = ValueList({"platform": "ecl_platform", "wobj0", "acadia": "rob2_acadia_EBIT_01", "zerowaste": "ecl_rob2_zerowaste"}, selected="zerowaste")
list_11 = ValueList({"world": "wobj0"}, selected="world")
data_10 = Data(list_6)
data_11 = Data(list_7)
panel_3 = Panel(rob_num)
panel_4 = Panel(rob_num)
filter = StreamFilter(Gate=panel_4, Stream1=list_9, Stream2=list_10, Stream3=list_11)
data_12 = Data(filter)

data_13 = Data(list_8)
panel_5 = Panel(rob_num)
filter_2 = StreamFilter(Gate=panel_5, Stream1=list_2, Stream2=list, Stream3=list_3)

filter_3 = StreamFilter(Gate=panel_3, Stream1=data_10, Stream2=data_11, Stream3=data_13)
data_14 = Data(filter_3)

r2_tcp_frames = Panel("""x1: [Frame(Point(2.766932, 1.480845, 0.366978), Vector(1.000, 0.024, -0.017), Vector(0.030, -0.855, 0.518))]
x2: [Frame(Point(3.108758, 1.478910, 0.367960), Vector(1.000, 0.024, -0.017), Vector(0.030, -0.855, 0.518))]
y1: [Frame(Point(3.108797, 1.667304, 0.366823), Vector(1.000, 0.024, -0.017), Vector(0.030, -0.855, 0.518))]""")
r3_tcp_frames = Panel("""x1: [Frame(Point(2.117427, 0.237057, 0.695275), Vector(-0.831, 0.545, 0.109), Vector(0.377, 0.697, -0.610))]
x2: [Frame(Point(1.775055, 0.240101, 0.695195), Vector(-0.831, 0.545, 0.109), Vector(0.377, 0.697, -0.610))]
y1: [Frame(Point(1.774582, 0.051813, 0.691629), Vector(-0.831, 0.546, 0.109), Vector(0.377, 0.697, -0.610))]""")
r1_tcp_frames = Panel("""x1: [Frame(Point(2.762768, 1.483214, 0.365833), Vector(-0.797, -0.574, -0.189), Vector(-0.506, 0.805, -0.311))]
x2: [Frame(Point(3.104401, 1.481151, 0.366987), Vector(-0.797, -0.574, -0.189), Vector(-0.506, 0.805, -0.311))]
y1: [Frame(Point(3.104434, 1.669760, 0.364630), Vector(-0.797, -0.574, -0.189), Vector(-0.506, 0.805, -0.311))]""")
python_13 = GhPythonScript()  # -> frames_wobj
# ---------- python_13: Python ----------
from compas.geometry import Frame
from compas.geometry import Point
from compas.geometry import Vector

#R1 calibration resulting frames
frames_wobj = {
'x1':Frame(Point(2.766932, 1.480845, 0.366978), Vector(1.000, 0.024, -0.017), Vector(0.030, -0.855, 0.518)),
'x2':Frame(Point(3.108758, 1.478910, 0.367960), Vector(1.000, 0.024, -0.017), Vector(0.030, -0.855, 0.518)),
'y1':Frame(Point(3.108797, 1.667304, 0.366823), Vector(1.000, 0.024, -0.017), Vector(0.030, -0.855, 0.518))
}

frames_wobj = [frames_wobj]
# ---------- end python_13 ----------
python_14 = GhPythonScript()  # -> frames_wobj
# ---------- python_14: Python ----------
from compas.geometry import Frame
from compas.geometry import Point
from compas.geometry import Vector

#R1 calibration resulting frames
frames_wobj = {
'x1':Frame(Point(2.762768, 1.483214, 0.365833), Vector(-0.797, -0.574, -0.189), Vector(-0.506, 0.805, -0.311)),
'x2':Frame(Point(3.104401, 1.481151, 0.366987), Vector(-0.797, -0.574, -0.189), Vector(-0.506, 0.805, -0.311)),
'y1':Frame(Point(3.104434, 1.669760, 0.364630), Vector(-0.797, -0.574, -0.189), Vector(-0.506, 0.805, -0.311))
}

frames_wobj = [frames_wobj]
# ---------- end python_14 ----------
python_15 = GhPythonScript()  # -> frames_wobj
# ---------- python_15: Python ----------
from compas.geometry import Frame
from compas.geometry import Point
from compas.geometry import Vector

#R1 calibration resulting frames
frames_wobj = {
'x1': Frame(Point(2.117427, 0.237057, 0.695275), Vector(-0.831, 0.545, 0.109), Vector(0.377, 0.697, -0.610)),
'x2': Frame(Point(1.775055, 0.240101, 0.695195), Vector(-0.831, 0.545, 0.109), Vector(0.377, 0.697, -0.610)),
'y1': Frame(Point(1.774582, 0.051813, 0.691629), Vector(-0.831, 0.546, 0.109), Vector(0.377, 0.697, -0.610))
}

frames_wobj = [frames_wobj]
# ---------- end python_15 ----------
panel_6 = Panel(rob_num)
filter_4 = StreamFilter(Gate=panel_6, Stream1=python_14, Stream2=python_13, Stream3=python_15)

data_15 = Data(filter_2)

# ----
# move/rotate plane around on rhino canvas
pt_3 = Point(<point referenced from the Rhino model>)
crv = Curve(<curve referenced from the Rhino model>)
crv_2 = Curve(<curve referenced from the Rhino model>)
crv_3 = Curve(<curve referenced from the Rhino model>)
crv_4 = Curve(<curve referenced from the Rhino model>)
crv_5 = Curve(<curve referenced from the Rhino model>)
crv_6 = Curve(<curve referenced from the Rhino model>)
pt_4 = Point(<point referenced from the Rhino model>)
pt_5 = Point(<point referenced from the Rhino model>)
pl = ConstructPlane(Origin=pt_3, XAxis=crv, YAxis=crv_6)
pl_2 = ConstructPlane(Origin=pt_4, XAxis=crv_2, YAxis=crv_3)
pl_3 = ConstructPlane(Origin=pt_5, XAxis=crv_4, YAxis=crv_5)
panel_7 = Panel(rob_num)
filter_5 = StreamFilter(Gate=panel_7, Stream1=pl, Stream2=pl_2, Stream3=pl_3)

# ----
# FORWARD KINEMATICS
config_3 = GhPythonScript(robot=data_2, r1=data_3, r2=data_4, r3=data_5)  # -> config; inputs r1: list, r2: list, r3: list
# ---------- config_3: Python ----------
import math

config = robot.zero_configuration()

for i in range(6):
    config['r1_joint_{}'.format(i + 1)] = math.radians(r1[i])
    config['r2_joint_{}'.format(i + 1)] = math.radians(r2[i])
    config['r3_joint_{}'.format(i + 1)] = math.radians(r3[i])

config['r1_cart_joint'] = r1[6]
config['r2_cart_joint'] = r2[6]

print config
# ---------- end config_3 ----------
gripper_frames = GhPythonScript(robot=data_2, group=data_14, config=config_3)  # -> out, tcf_draw
# ---------- gripper_frames: Python ----------
from compas_ghpython.artists import FrameArtist

frame_tcf = robot.forward_kinematics(config, group=group)
print frame_tcf

artist = FrameArtist(frame_tcf)
tcf_draw = artist.draw()
# ---------- end gripper_frames ----------
pln_5 = Plane(gripper_frames.tcf_draw)
panel_8 = Panel(pln_5)

pln_6 = Plane(filter_5)

# ----
# INVERSE KINEMATICS
use_fk_as_start = BooleanToggle(True)
data_16 = Data(config_3)
filter_6 = StreamFilter(Gate=use_fk_as_start, Stream1=data_16)
pln_7 = Plane(pln_6)
data_17 = Data(filter_6)
ik = InverseKinematics(robot=data_2, plane=pln_7, start_configuration=data_17, group=data_14)  # -> configuration
#   port plane: The plane or frame to calculate the inverse kinematic for.
#   port start_configuration: If passed, calculates the inverse such that the joint positions differ the least from the start_configuration. Defaults to the zero configuration.
#   port group: The planning group used for calculation. Defaults to the robot's main planning group.
#   port configuration: The planning group's configuration.
# ---------- ik: Python ----------
"""
Calculate the robot's inverse kinematic for a given plane.

COMPAS FAB v0.19.1
"""
from ghpythonlib.componentbase import executingcomponent as component

from compas_fab.ghpython.components import coerce_frame


class InverseKinematics(component):
    def RunScript(self, robot, plane, start_configuration, group):
        configuration = None
        if robot and robot.client and robot.client.is_connected and plane:
            frame = coerce_frame(plane)
            configuration = robot.inverse_kinematics(frame, start_configuration, group)
        if start_configuration:
            return start_configuration.merged(configuration)
        else:
            return configuration
# ---------- end ik ----------

python_16 = GhPythonScript()  # -> frame_tool
# ---------- python_16: Python ----------
from compas.geometry import Frame

#calibration tip tcp measured in (at 0)
frame_tool = Frame([0.000473456,0.000169985,0.163856], [1, 0, 0], [0, 1, 0])
# ---------- end python_16 ----------
python_17 = GhPythonScript()  # -> frame_tool
# ---------- python_17: Python ----------
from compas.geometry import Frame

#calibration tip tcp measured in (at 0)
frame_tool = Frame([0.000583723,0.0000236933,0.0779321], [1, 0, 0], [0, 1, 0])
# ---------- end python_17 ----------
python_18 = GhPythonScript()  # -> frame_tool
# ---------- python_18: Python ----------
from compas.geometry import Frame

#calibration tip tcp measured in (at 0)
frame_tool = Frame([-0.000441033,-0.0000930574,0.164273], [1, 0, 0], [0, 1, 0])
# ---------- end python_18 ----------
panel_9 = Panel(rob_num)
filter_7 = StreamFilter(Gate=panel_9, Stream1=python_18, Stream2=python_16, Stream3=python_17)

# ----
# tool TCF based on:
# actual values from controller
python_19 = GhPythonScript(point=list_4, frames_wobj=filter_4)  # -> out, tcf_draw, frame_tcf; inputs frames_wobj: list
# ---------- python_19: Python ----------
from compas_ghpython.artists import FrameArtist

frame_tcf = frames_wobj[0][point]
print frame_tcf

artist = FrameArtist(frame_tcf)
tcf_draw = artist.draw()
# ---------- end python_19 ----------
pln_8 = Plane(python_19.tcf_draw)

# ----
# tool TCF based on:
# FK using the URDF as defined
gripper_frames_2 = GhPythonScript(robot=data_2, group=data_14, config=python.config_scaled)  # -> out, tcf_draw, frame_tcf; same code as gripper_frames
pln_9 = Plane(gripper_frames_2.tcf_draw)

list_12 = ValueList({"Forward Kinematics": 0, "Inverse Kinematics": 1, "Preset Start Planning Config": 2, "Preset Return Config": 3, "Preset WOBJ Points": 4}, selected="Inverse Kinematics")
filter_8 = StreamFilter(
    Gate=list_12,
    Stream0=config_3,
    Stream1=ik,
    Stream2=config.config_scaled,
    Stream3=config_2.config_scaled,
    Stream4=python.config_scaled)

# ----
# difference between TCF from URDF and CONTROLLER (mm)
python_20 = GhPythonScript(tcf_urdf=gripper_frames_2.frame_tcf, tcf_actual=python_19.frame_tcf)  # -> out, point_diff
# ---------- python_20: Python ----------
from compas.geometry import Transformation

diff = Transformation.from_frame_to_frame(tcf_urdf,tcf_actual)

point_diff = tcf_urdf.point - tcf_actual.point

#print diff
print 1000*point_diff.x, 1000*point_diff.y, 1000*point_diff.z
# ---------- end python_20 ----------
rec = DataRecorder(python_20.out, DataLimit=-10, RecordData=False)
data_18 = Data(rec)
panel_10 = Panel(data_18)
panel_11 = Panel(pln_9)
panel_12 = Panel(pln_8)

robot_visualize = RobotVisualize(
    robot=data_2,
    group=data_14,
    configuration=filter_8,
    show_visual=Toggle(True),
    show_collision=Toggle(False),
    show_frames=Toggle(False),
    show_base_frame=Toggle(False),
    show_end_effector_frame=Toggle(True))  # -> visual, collision, attached_meshes, frames, base_frame, ee_frame; inputs attached_collision_meshes: list, show_visual: Boolean, show_collision: Boolean, show_frames: Boolean, show_base_frame: Boolean, show_end_effector_frame: Boolean, show_acm: Boolean
#   port group: The planning group used for end-effector and base visualization.
#   port configuration: The robot's full configuration.
#   port attached_collision_meshes: A list of attached collision meshes.
#   port show_visual: Whether or not to show the robot's visual meshes.
#   port show_collision: Whether or not to show the robot's collision meshes.
#   port show_frames: Whether or not to show the robot's joint frames.
#   port show_base_frame: Whether or not to show the robot's base frame.
#   port show_end_effector_frame: Whether or not to show the robot's end-effector frame.
#   port show_acm: Whether or not to show the attached collision meshes (if any).
#   port visual: The robot's visual Rhino meshes (if any).
#   port collision: The robot's collision Rhino meshes (if any).
#   port attached_meshes: The attached collision Rhino meshes (if any).
#   port frames: The robot's joint frames as Rhino planes (if any).
#   port base_frame: The robot's base frame as a Rhino plane (if any).
#   port ee_frame: The robot's end-effector frame as a Rhino plane (if any).
# ---------- robot_visualize: Python ----------
"""
Visualizes the robot.

COMPAS FAB v0.19.1
"""
from compas.geometry import Frame
from compas.geometry import Transformation
from compas_ghpython.artists import FrameArtist
from compas_ghpython.artists import MeshArtist
from ghpythonlib.componentbase import executingcomponent as component


class RobotVisualize(component):
    def RunScript(self, robot, group, configuration, attached_collision_meshes, show_visual, show_collision,
                  show_frames, show_base_frame, show_end_effector_frame, show_acm):

        visual = None
        collision = None
        attached_meshes = None
        frames = None
        base_frame = None
        ee_frame = None

        if robot:
            show_visual = True if show_visual is None else show_visual
            configuration = configuration or robot.zero_configuration()

            robot.update(configuration, visual=show_visual, collision=show_collision)
            compas_frames = robot.transformed_frames(configuration, group)

            if show_visual:
                visual = robot.artist.draw_visual()

            if show_collision:
                collision = robot.artist.draw_collision()

            if show_base_frame:
                base_compas_frame = compas_frames[0]
                artist = FrameArtist(base_compas_frame)
                base_frame = artist.draw()

            if show_end_effector_frame:
                ee_compas_frame = robot.forward_kinematics(configuration, group, options=dict(solver='model'))
                artist = FrameArtist(ee_compas_frame)
                ee_frame = artist.draw()

            if show_frames:
                frames = []
                for compas_frame in compas_frames[1:]:
                    artist = FrameArtist(compas_frame)
                    frame = artist.draw()
                    frames.append(frame)

            if show_acm:
                attached_meshes = []
                for acm in attached_collision_meshes:
                    frame = robot.forward_kinematics(configuration, options=dict(solver='model', link_name=acm.link_name))
                    T = Transformation.from_frame_to_frame(Frame.worldXY(), frame)
                    mesh = acm.collision_mesh.mesh.transformed(T)
                    attached_meshes.append(MeshArtist(mesh).draw())

        return (visual, collision, attached_meshes, frames, base_frame, ee_frame)
# ---------- end robot_visualize ----------
pln_10 = Plane(robot_visualize.frames)
pln_11 = Plane(robot_visualize.base_frame)
pln_12 = Plane(robot_visualize.ee_frame)

item = ListItem(List=pln_10, Index=Slider(27, range=0..37), Wrap=True)
pln_13 = Plane(item)
pln_14 = Plane(pln_12)

python_21 = GhPythonScript(p_send=pln_14)  # -> f_send; inputs p_send: list
# ---------- python_21: Python ----------
from compas.geometry import Frame
from compas.geometry import Point
from compas.geometry import Vector
from compas.geometry import Transformation
from compas_ghpython import draw_frame
from compas_rhino.geometry import RhinoPlane
import copy

f_send = []
for p in p_send:
    f = RhinoPlane.from_geometry(p).to_compas()
    f_new = copy.deepcopy(f)
    f_new.point = f.point*1000
    
    f_send.append(f_new)
    

#p=[3103.33,1481.11,366.83]
#wobj_true1 = Frame.from_quaternion([0.999976,-0.00604606,-0.00149283,-0.0029774],p)
#
#p = [3107.65,1478.91,367.994]
#wobj_true2 = Frame.from_quaternion([0.99999,-0.00305874,-0.00165978,-0.0029736], p)
#
#
#tt = Transformation.from_frame_to_frame(wobj_true1,wobj_true2)
#f_send = wobj_true2.transformed(tt.inverse())
#
#f_send = wobj_true2

print f_send
# ---------- end python_21 ----------
python_22 = GhPythonScript()  # -> out, T
# ---------- python_22: Python ----------
from compas.geometry import Frame
from compas.geometry import Transformation

p=[3103.33,1481.11,366.83]
wobj_true1 = Frame.from_quaternion([0.999976,-0.00604606,-0.00149283,-0.0029774],p)

p = [3107.65,1478.91,367.994]
wobj_true2 = Frame.from_quaternion([0.99999,-0.00305874,-0.00165978,-0.0029736], p)

T = Transformation.from_frame_to_frame(wobj_true1,wobj_true2)

print wobj_true2.transformed(T.inverse())
print T
# ---------- end python_22 ----------
data_19 = Data(data_7)
data_20 = Data(data_8)
data_21 = Data(data_6)
python_23 = GhPythonScript(wobj=data_21, f_send=python_21, T=python_22.T)  # -> f_send_wobj, wobj_true; inputs f_send: list
# ---------- python_23: Python ----------
from compas.geometry import Frame
from compas_ghpython import draw_frame
from compas_rhino.geometry import RhinoPlane
import copy


#p=[3103.33,1481.11,366.83]
#wobj_true = Frame.from_quaternion([0.999976,-0.00604606,-0.00149283,-0.0029774],p)

f_send_wobj = []
for f in f_send:
    f_new = copy.deepcopy(f)
#    f_new = f_new.transformed(T.inverse())
    f_send_wobj.append(wobj.to_local_coordinates(f_new))
    
print f_send_wobj
# ---------- end python_23 ----------
python_24 = GhPythonScript(wobj=data_19, f_send=python_21)  # -> f_send_wobj, wobj_true; inputs f_send: list
# ---------- python_24: Python ----------
from compas.geometry import Frame
from compas_ghpython import draw_frame
from compas_rhino.geometry import RhinoPlane
import copy


#p = [3107.65,1478.91,367.994]
#wobj_true = Frame.from_quaternion([0.99999,-0.00305874,-0.00165978,-0.0029736], p)

f_send_wobj = []
for f in f_send:
    f_new = copy.deepcopy(f)
    f_send_wobj.append(wobj.to_local_coordinates(f_new))
    
print f_send_wobj
# ---------- end python_24 ----------
python_25 = GhPythonScript(wobj=data_20, f_send=python_21)  # -> f_send_wobj, wobj_true; inputs f_send: list
# ---------- python_25: Python ----------
from compas.geometry import Frame
from compas.geometry import Rotation

from compas_ghpython import draw_frame
from compas_rhino.geometry import RhinoPlane
import copy
import math

f_send_wobj = []
for f in f_send:
    f_new = copy.deepcopy(f)
    f_send_wobj.append(wobj.to_local_coordinates(f_new))
    
print f_send_wobj
# ---------- end python_25 ----------

panel_13 = Panel(data_15)
# SEND ROBOT COMMANDS
panel_14 = Panel(data_12)
panel_15 = Panel(rob_num)
data_22 = Data(data_2)
data_23 = Data(data)

python_26 = GhPythonScript(
    robot=data_22,
    ros=data_23,
    rob_num=panel_15,
    wobj=panel_14,
    tool=panel_13,
    return_config=data_9,
    send_return=Button(),
    r1_pick_path=python_23.f_send_wobj,
    r2_pick_path=python_24.f_send_wobj,
    r3_pick_path=python_25.f_send_wobj,
    send_pick=Button(),
    get_current_config=Toggle(False))  # -> out, current_joints, config; inputs rob_num: Int32, r1_pick_path: list, r2_pick_path: list, r3_pick_path: list, r1_place_startpath: list, r2_place_startpath: list, r1_place_endpath: list, r2_place_endpath: list
# ---------- python_26: Python ----------
import math

import compas_rrc as rrc
from compas.geometry import Frame
from compas.geometry import Plane

from compas_rhino.geometry import RhinoPlane

# Create ABB Client (rob2 = right, rob1 = left)
if rob_num == 1:
    abb = rrc.AbbClient(ros, '/rob1')
#    abb.send(rrc.SetTool('ecl_pneumatic_gripper'))
    DO = 'do_1'
    pick_path = r1_pick_path
elif rob_num == 2:
    abb = rrc.AbbClient(ros, '/rob2')
#    abb.send(rrc.SetTool('ecl_pneumatic_gripper'))
    DO = 'do_2'
    pick_path = r2_pick_path
elif rob_num == 3:
    abb = rrc.AbbClient(ros, '/rob3')
    pick_path = r3_pick_path

# Define speeds
speed = 100

# set wobj
abb.send(rrc.SetWorkObject(wobj))
abb.send(rrc.SetTool(tool))

if get_info:
    current_joints = abb.send_and_wait(rrc.GetJoints(),  timeout = 3)
    print current_joints
    

if send_return:
    if rob_num == 1:
        axis = rrc.ExternalAxes(return_config['r1_cart_joint'])
        joints = rrc.RobotJoints(
            return_config['r1_joint_1'],
            return_config['r1_joint_2'],
            return_config['r1_joint_3'],
            return_config['r1_joint_4'],
            return_config['r1_joint_5'],
            return_config['r1_joint_6'],
        )
    elif rob_num == 2:
        axis = rrc.ExternalAxes(return_config['r2_cart_joint'])
        joints = rrc.RobotJoints(
            return_config['r2_joint_1'],
            return_config['r2_joint_2'],
            return_config['r2_joint_3'],
            return_config['r2_joint_4'],
            return_config['r2_joint_5'],
            return_config['r2_joint_6'],
        )
        
    done = abb.send(rrc.MoveToJoints(joints, axis, speed, rrc.Zone.FINE))
    print('Finished')


if get_current_config:
    config = robot.zero_configuration()
    current_joints, current_track = abb.send_and_wait(rrc.GetJoints(), timeout=3)

    if rob_num in [1, 2]:  # only R1 and R2 have an external axis
        config["r{}_cart_joint".format(rob_num)] = current_track[0]/1000

    config["r{}_joint_1".format(rob_num)] = math.radians(current_joints[0])
    config["r{}_joint_2".format(rob_num)] = math.radians(current_joints[1])
    config["r{}_joint_3".format(rob_num)] = math.radians(current_joints[2])
    config["r{}_joint_4".format(rob_num)] = math.radians(current_joints[3])
    config["r{}_joint_5".format(rob_num)] = math.radians(current_joints[4])
    config["r{}_joint_6".format(rob_num)] = math.radians(current_joints[5])

    print config
    
    
if send_pick:
    
    for f in pick_path:
        done = abb.send_and_wait(rrc.MoveToFrame(f, speed, rrc.Zone.FINE), timeout = 30)
        future = abb.send(rrc.Stop(feedback_level=rrc.FeedbackLevel.DONE))
    
    
if send_place_start:
    # execute planned path
    # formatted as RobotJoints and ExternalAxes object 
    
    last_axis, last_joints = path_place_s.pop(-1)
    
    for axis,joints in path_place_s:
        print axis, joints
        done = abb.send(rrc.MoveToJoints(joints, axis, speed, rrc.Zone.Z10))
    
    done = abb.send(rrc.MoveToJoints(last_joints, last_axis, speed, rrc.Zone.FINE))
    print('Finished')

if send_place_end:
    # execute planned path
    # formatted as RobotJoints and ExternalAxes object 
    
    last_axis, last_joints = path_place_e.pop(-1)
    
    for axis,joints in path_place_e:
        print axis, joints
        done = abb.send(rrc.MoveToJoints(joints, axis, speed/3, rrc.Zone.Z10))
        
    done = abb.send(rrc.MoveToJoints(last_joints, last_axis, speed/3, rrc.Zone.FINE))
    print('Finished')
# ---------- end python_26 ----------

data_24 = Data(python_26.config)
gripper_frames_3 = GhPythonScript(robot=data_2, group=data_14, config=data_24)  # -> out, tcf_draw; same code as gripper_frames
pln_15 = Plane(gripper_frames_3.tcf_draw)
panel_16 = Panel(pln_15)

merge = Merge(
    Data1=Plane(origin=(3.109938882, 1.666668628, 0.3677391208), x=(0.8260121973, -0.5548985055, 0.09895200125), y=(-0.3833161605, -0.6817218083, -0.6231565591)),
    Data2=Plane(origin=(3.107775037, 1.478289406, 0.3677457476), x=(0.8260888812, -0.5547778347, 0.09898845616), y=(-0.3831785001, -0.6817655984, -0.6231933134)),
    Data3=Plane(origin=(2.765288031, 1.484383582, 0.3679941697), x=(0.8260418935, -0.554845965, 0.09899871324), y=(-0.3832260527, -0.6817329122, -0.6231998306)),
    Data4=Plane(origin=(3.503014585, 1.675228971, 1.154453602), x=(0.1461748722, -0.242230103, -0.9591441414), y=(-0.2352960635, -0.9502469572, 0.2041236952)),
    Data5=pln_12)
merge_2 = Merge(
    Data1=Plane(origin=(3.108857096, 1.666146206, 0.3674745328), x=(0.8260138439, -0.5548948824, 0.09895857258), y=(-0.3833085952, -0.6817239308, -0.6231588907)),
    Data2=Plane(origin=(3.106679089, 1.477694501, 0.3675023636), x=(0.8260920963, -0.5547739983, 0.09898312581), y=(-0.3831804997, -0.6817686988, -0.6231886922)),
    Data3=Plane(origin=(2.764036039, 1.483805149, 0.367934475), x=(0.8260330858, -0.5548612273, 0.09898666323), y=(-0.3832440119, -0.68172153, -0.6232012379)),
    Data4=Plane(origin=(3.503075469, 1.674974272, 1.154010892), x=(0.1461428014, -0.2422253857, -0.9591502198), y=(-0.2352817858, -0.95024948, 0.2041284081)),
    Data5=pln_15)

panel_17 = Panel("CONTROLLER-URDF")
panel_18 = Panel("MODEL")
deplane = DeconstructPlane(Plane=merge)  # -> Origin, XAxis, YAxis, ZAxis
deplane_2 = DeconstructPlane(Plane=merge_2)  # -> Origin, XAxis, YAxis, ZAxis
subtraction = Subtraction(A=deplane.Origin, B=deplane_2.Origin)
multiplication = Multiplication(A=subtraction, B="1000")
avr = Average(Input=multiplication)
panel_19 = Panel(multiplication)
panel_20 = Panel(avr)
