# Grasshopper definition check_urdf.ghx (Grasshopper 1.0.7)

list = ValueList({"IRB4600": "abb_irb4600_40_255", "IRB7600": "abb_irb7600_400_255", "IRB4600+track": "abb_on_axis", "2 Robot Cell": "princeton_2rob_cell", "3 Robot Cell": "princeton_3rob_cell"}, selected="3 Robot Cell")
py = GhPythonScript()  # -> filepath
# ---------- py: Python ----------
import os

filename = ghenv.Component.OnPingDocument().FilePath

filepath = os.path.join(os.path.dirname(filename), "..")

filepath = os.path.abspath(filepath)
print filepath
# ---------- end py ----------
panel = Panel("Check URDF")
python = GhPythonScript(name=list, is_mac=Toggle(True))  # -> filepath, name
# ---------- python: Python ----------
if is_mac:
    filepath = "{i}/urdf/{i}.urdf".format(i = name)
else:
    filepath = "{i}\urdf\{i}.urdf".format(i = name)

print name
print filepath
# ---------- end python ----------
panel_2 = Panel(py)
panel_3 = Panel(python.filepath)
python_2 = GhPythonScript(filepath=py, path="catkin", urdf_filename=python.filepath)  # -> urdf_filename, path
# ---------- python_2: Python ----------
import os


urdf_filename = os.path.join(filepath, path, urdf_filename)
print urdf_filename

path = os.path.join(filepath, path)
print path
# ---------- end python_2 ----------
panel_4 = Panel(python_2.urdf_filename)
python_3 = GhPythonScript(urdf_filename=python_2.urdf_filename, path=python_2.path, name=python.name, load_geometry=Toggle(False))  # -> model
# ---------- python_3: Python ----------
from compas.robots import LocalPackageMeshLoader
from compas.robots import RobotModel

model = RobotModel.from_urdf_file(urdf_filename)
print model
print path
print name

if load_geometry:
    
    loaders = [LocalPackageMeshLoader(path, name)]
    
    if name in ['abb_on_axis']:
        loaders.append(LocalPackageMeshLoader(path, 'abb_irb4600_40_255'))
    elif name in ['princeton_2rob_cell']:
        loaders.append(LocalPackageMeshLoader(path, 'abb_irb4600_40_255'))
        loaders.append(LocalPackageMeshLoader(path, 'abb_on_axis'))
    elif name in ['princeton_3rob_cell']:
        loaders.append(LocalPackageMeshLoader(path, 'abb_irb4600_40_255'))
        loaders.append(LocalPackageMeshLoader(path, 'abb_irb7600_400_255'))
        loaders.append(LocalPackageMeshLoader(path, 'abb_on_axis'))
    
    model.load_geometry(*loaders)
# ---------- end python_3 ----------
python_4 = GhPythonScript(model=python_3, zero_config=Toggle(False))  # -> G, config, r
# ---------- python_4: Python ----------
from compas_ghpython.artists import RobotModelArtist
from compas_fab.robots import Robot

r = Robot(model)
r.artist = RobotModelArtist(model)

if zero_config:
    config = model.zero_configuration()
    print config
else:
    config = model.zero_configuration()
    config['r1_joint_1'] = 0
    config['r1_joint_2'] = 1
    config['r1_joint_3'] = -0.25
    config['r1_joint_4'] = 1
    config['r1_joint_5'] = -0.5
    config['r1_joint_6'] = 1

print config

artist = RobotModelArtist(model)
G = artist.draw_visual()
# ---------- end python_4 ----------
robot_visualize = RobotVisualize(robot=python_4.r, configuration=python_4.config)  # -> visual, collision, attached_meshes, frames, base_frame, ee_frame; inputs attached_collision_meshes: list, show_visual: Boolean, show_collision: Boolean, show_frames: Boolean, show_base_frame: Boolean, show_end_effector_frame: Boolean, show_acm: Boolean
#   port group: The planning group used for end-effector and base visualization.
#   port configuration: The robot's full configuration.
#   port attached_collision_meshes: A list of attached collision meshes.
#   port show_visual: Whether or not to show the robot's visual meshes.
#   port show_collision: Whether or not to show the robot's collision meshes.
#   port show_frames: Whether or not to show the robot's joint frames.
#   port show_base_frame: Whether or not to show the robot's base frame.
#   port show_end_effector_frame: Whether or not to show the robot's end-effector frame.
#   port show_acm: Whether or not to show the attached collision meshes (if any).
#   port visual: The robot's visual Rhino meshes (if any).
#   port collision: The robot's collision Rhino meshes (if any).
#   port attached_meshes: The attached collision Rhino meshes (if any).
#   port frames: The robot's joint frames as Rhino planes (if any).
#   port base_frame: The robot's base frame as a Rhino plane (if any).
#   port ee_frame: The robot's end-effector frame as a Rhino plane (if any).
# ---------- robot_visualize: Python ----------
"""
Visualizes the robot.

COMPAS FAB v0.22.0
"""
from compas.geometry import Frame
from compas.geometry import Transformation
from compas_ghpython.artists import FrameArtist
from compas_ghpython.artists import MeshArtist
from ghpythonlib.componentbase import executingcomponent as component


class RobotVisualize(component):
    def RunScript(self, robot, group, configuration, attached_collision_meshes, show_visual, show_collision,
                  show_frames, show_base_frame, show_end_effector_frame, show_acm):

        visual = None
        collision = None
        attached_meshes = None
        frames = None
        base_frame = None
        ee_frame = None

        if robot:
            show_visual = True if show_visual is None else show_visual
            configuration = configuration or robot.zero_configuration()

            robot.update(configuration, visual=show_visual, collision=show_collision)
            compas_frames = robot.transformed_frames(configuration, group)

            if show_visual:
                visual = robot.artist.draw_visual()

            if show_collision:
                collision = robot.artist.draw_collision()

            if show_base_frame:
                base_compas_frame = compas_frames[0]
                artist = FrameArtist(base_compas_frame)
                base_frame = artist.draw()

            if show_end_effector_frame:
                ee_compas_frame = robot.forward_kinematics(configuration, group, options=dict(solver='model'))
                artist = FrameArtist(ee_compas_frame)
                ee_frame = artist.draw()

            if show_frames:
                frames = []
                for compas_frame in compas_frames[1:]:
                    artist = FrameArtist(compas_frame)
                    frame = artist.draw()
                    frames.append(frame)

            if show_acm:
                attached_meshes = []
                for acm in attached_collision_meshes:
                    frame = robot.forward_kinematics(configuration, options=dict(solver='model', link_name=acm.link_name))
                    T = Transformation.from_frame_to_frame(Frame.worldXY(), frame)
                    mesh = acm.collision_mesh.mesh.transformed(T)
                    attached_meshes.append(MeshArtist(mesh).draw())

        return (visual, collision, attached_meshes, frames, base_frame, ee_frame)
# ---------- end robot_visualize ----------
